# Grasshopper definition NN-MNIST-crow-owl.gh (Grasshopper 0.9.76)
# plug-ins: Anemone, Owl.Accord.GH, Crow, Owl.GH

# Images
path = FilePath("C:\Users\David.Valent\Dropbox\train-images-idx3-ubyte\train-images.idx3-ubyte")
# Labels
number_slider = Slider(0.01, range=0..0.01)
path_2 = FilePath("C:\Users\David.Valent\Dropbox\train-labels-idx1-ubyte\train-labels.idx1-ubyte")
subsample = SubsampleTSet(TensorSet=path_2, Amount=number_slider, Seed=123)
subsample_2 = SubsampleTSet(TensorSet=path, Amount=number_slider, Seed=123)
detset = DeconstructTensorSet(TensorSet=subsample)
panel = Panel(subsample_2)
number_slider_2 = Slider(187, range=0..300)
reshape = Reshape(Tensor=detset, Shape="1")
remap = RemapTSet(TensorSet=subsample_2, Source="0 to 255", Target=Domain(0, 1))
detensor = DeconstructTensor(Tensor=reshape)  # -> flatten(Values)
detset_2 = DeconstructTensorSet(TensorSet=remap)

# ---- group: Pick set
lng = ListLength(List=detset_2)
dom = ConstructDomain(DomainStart=0, DomainEnd=lng)
random = Random(Range=dom, Number=Slider(13, range=0..100), Seed=2)
int = Integer(random)

# ----
item = ListItem(List=reshape, Index=number_slider_2, Wrap=True)
item_2 = ListItem(List=detset_2, Index=number_slider_2, Wrap=True)
onehot = OneHotTensorSet(Hot=detensor, Length=10, HotValue=1, ColdValue=0)
panel_2 = Panel(item)
detset_3 = DeconstructTensorSet(TensorSet=onehot)
_2dpreview = Tensor2DPreview(Tensor2D=item_2, Range=Domain(0, 0), SaveAll=False)

# ---- group: Pick from set
pick = PickTensor(TensorSet=subsample, Indices=int, Wrap=True)
pick_2 = PickTensor(TensorSet=path, Indices=Slider(7042, range=0..10000), Wrap=True)
detset_4 = DeconstructTensorSet(TensorSet=pick)
detensor_2 = DeconstructTensor(Tensor=detset_4)
_2dpreview_2 = Tensor2DPreview(Tensor2D=pick_2, Range=Domain(0, 0), SaveAll=False)

# ----
mynumber = Data([0, 0, 0, 0, 0, 0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])
panel_3 = Panel("""28
28""")

# ---- group: My Number
tensor = ConstructTensor(Values=mynumber)  # -> flatten(Tensor)
reshape_2 = Reshape(Tensor=tensor, Shape=panel_3)
_2dpreview_3 = Tensor2DPreview(Tensor2D=reshape_2, Range=Domain(0, 0), SaveAll=False)

# ---- group: OWL
multiplication = Multiplication(A="28", B="28")
panel_4 = Panel("""10
10""")
merge = Merge(Data1=flatten(multiplication), Data2=flatten(panel_4))  # -> flatten(Result)
network = ConstructNetwork(Layers=merge, Activation=0, Alpha=2, Seed=123)
number_slider_3 = Slider(1000, range=0..1000)
mergets = MergeTSet(TensorSets=detset_2)
mergets_2 = MergeTSet(TensorSets=detset_3)
loop_start = LoopStart(Repeat=Slider(300, range=0..1000), Data=network)  # -> port, Counter, Data
backprop = Backpropagation(
    ActivationNetwork=loop_start.Data,
    Input=mergets,
    Output=mergets_2,
    LearningRate=0.01,
    Momentum=0.001,
    Epoch=10,
    Iterations=Slider(100, range=0..1000))  # -> ActivationNetwork, Error
panel_5 = Panel(backprop.Error)
loop_end = LoopEnd(
    port=loop_start.port,
    Exit=False,
    Data=backprop.ActivationNetwork,
    pausedState=False,
    state="Constant output",
    TimeOutVal=0)
loop = Panel(loop_start.Counter)
compute = Compute(ActivationNetwork=backprop.ActivationNetwork, Input=tensor)
rec = DataRecorder(backprop.Error, DataLimit=-10, RecordData=True)
detset_5 = DeconstructTensorSet(TensorSet=compute)
detensor_3 = DeconstructTensor(Tensor=detset_5)
graph = QuickGraph(rec)
lng_2 = ListLength(List=detensor_3)
series = Series(Start=0, Step=1, Count=lng_2)
sort = SortList(Keys=detensor_3, ValuesA=series)  # -> reverse(Keys), reverse(ValuesA)
item_3 = ListItem(List=sort.ValuesA, Index=0, Wrap=True)
int_2 = Integer(item_3)
panel_6 = Panel(int_2)
panel_7 = Panel(detensor_3)
graph_2 = QuickGraph(detensor_3)

# ---- group: CROW
panel_8 = Panel("""0
0
0""")
panel_9 = Panel("""10
10
10""")
detensor_4 = DeconstructTensor(Tensor=detset_2)  # -> simplify(Values)
detensor_5 = DeconstructTensor(Tensor=detset_3)  # -> simplify(Values)
backprop_2 = CrowNetConstructorBackpropagationNetwork(LayerStructure=panel_8, NeuronCount=panel_9, LearningRate=0.2)
trained_data_1_3000c_568batch_5_2min = Data("Grasshopper.Kernel.Types.GH_ObjectWrapper")
crow_bp = CrowEngineBackpropagation(
    Cycles=Slider(2000, range=0..10000),
    CrowNetBackpropagation=backprop_2,
    TrainingInputVectors=detensor_4,
    TrainingOutputVectors=detensor_5)  # -> MeanSquareError, Network; disabled
detensor_6 = DeconstructTensor(Tensor=reshape_2)
panel_10 = Panel(crow_bp.MeanSquareError)
panel_11 = Panel(crow_bp.Network)
bp_vc = BackpropagationVectorClassifier(CrowNet=trained_data_1_3000c_568batch_5_2min, InputVector=detensor_6)
lng_3 = ListLength(List=bp_vc)
series_2 = Series(Start=0, Step=1, Count=lng_3)
sort_2 = SortList(Keys=bp_vc, ValuesA=series_2)  # -> reverse(Keys), reverse(ValuesA)
item_4 = ListItem(List=sort_2.ValuesA, Index=0, Wrap=True)
int_3 = Integer(item_4)
graph_3 = QuickGraph(bp_vc)
panel_12 = Panel(int_3)
panel_13 = Panel(bp_vc)
