# Grasshopper definition NN-MNIST.gh (Grasshopper 0.9.76)
# plug-ins: Owl.Accord.GH, Owl.GH

# Images
path = FilePath("C:\Users\David.Valent\Desktop\Temp\t10k-images-idx3-ubyte\t10k-images.idx3-ubyte")
# Values
path_2 = FilePath("C:\Users\David.Valent\Desktop\Temp\t10k-labels-idx1-ubyte\t10k-labels.idx1-ubyte")
loadtset = LoadTensorSet(LoadFile=path_2, Position=0, Count=-1)
loadtset_2 = LoadTensorSet(LoadFile=path, Position=0, Count=-1)
number_slider = Slider(6, range=0..10)
number_slider_2 = Slider(0, range=0..500)
detset = DeconstructTensorSet(TensorSet=loadtset)
detset_2 = DeconstructTensorSet(TensorSet=loadtset_2)
detensor = DeconstructTensor(Tensor=detset)  # -> simplify(flatten(Values))
item = ListItem(List=detset_2, Index=number_slider, Wrap=True)
item_2 = ListItem(List=detensor, Index=number_slider, Wrap=True)
panel = Panel(item_2)
_2dpreview = Tensor2DPreview(Tensor2D=item, Range=Domain(0, 0), SaveAll=False)
stats = TensorStats(Tensor=item)  # -> Count, Shape
remap = RemapTSet(TensorSet=loadtset_2, Source="0 to 255", Target=Domain(0, 1))
remap_2 = RemapTSet(TensorSet=loadtset, Source="0 to 10", Target=Domain(0, 1))
detset_3 = DeconstructTensorSet(TensorSet=remap)
detset_4 = DeconstructTensorSet(TensorSet=remap_2)

# ---- group: TEST PORTION
subset = SubList(List=detset_3, Domain="0 to 100", Wrap=True)  # -> List, Index
subset_2 = SubList(List=detset_4, Domain="0 to 100", Wrap=True)  # -> List, Index

# ----
number_slider_3 = Slider(28, range=0..100)
multiplication = Multiplication(A=number_slider_3, B=number_slider_3)
mergets = MergeTSet(TensorSets=subset.List)
mergets_2 = MergeTSet(TensorSets=subset_2.List)
merge = Merge(
    Data1=multiplication,
    Data2=[Slider(10, range=0..20), Slider(10, range=0..20), Slider(10, range=0..20)],
    Data3=Slider(1, range=0..10))  # -> flatten(Result)
subset_3 = SubList(List=detset_3, Domain="0 to 10", Wrap=True)  # -> List, Index
network = ConstructNetwork(Layers=merge, Activation=0, Alpha=2, Seed=123)
backprop = Backpropagation(
    ActivationNetwork=network,
    Input=mergets,
    Output=mergets_2,
    LearningRate=0.01,
    Momentum=0.001,
    Epoch=10,
    Iterations=Slider(3000, range=0..10000))  # -> ActivationNetwork, Error
panel_2 = Panel(backprop.Error)
lng = ListLength(List=subset_3.List)
item_3 = ListItem(List=subset_3.List, Index=0, Wrap=True)
_2dpreview_2 = Tensor2DPreview(Tensor2D=item_3, Range=Domain(0, 0), SaveAll=False)
_2dpreview_3 = NetworkPreview(Network=backprop.ActivationNetwork, Lines=Domain(1, 5), Radius=5)
compute = Compute(ActivationNetwork=backprop.ActivationNetwork, Input=subset_3.List)
detset_5 = DeconstructTensorSet(TensorSet=compute)
detensor_2 = DeconstructTensor(Tensor=detset_5)
panel_3 = Panel(detensor_2)
