# Grasshopper definition mnistNN.gh (Grasshopper 0.9.76)
# plug-ins: LunchBox, Crow

# ----
# construct neural network
# nr. of training cycles
# types of different network layers
# (0 = Sigmoid, 1 = Linear, 2 = Logarithmic, 3 = Sine, 4 = TanH)
# nr. of neurons per layer
panel = Panel("3000")
panel_2 = Panel("""0
0
0""")
panel_3 = Panel("""10
10
10""")

file_path = FilePath("C:\Users\Kacper\Desktop\train2.csv")
excel_reader = ExcelReader(ReadExcelData=Toggle(True), WorkbookPath=file_path, WorksheetName="train2")  # -> Exceptions, ExcelData

# ----
# mnist data of 1000 examples
flip_matrix = FlipMatrix(Data=Tree({0}: ["label", "1", "0", "1", "4", "0"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], {1}: ["pixel0", "0", "0", "0", "0", "0"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], {2}: ["pixel1", "0", "0", "0", "0", "0"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], {3}: ["pixel2", "0", "0", "0", "0", "0"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], {4}: ["pixel3", "0", "0", "0", "0", "0"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], {5}: ["pixel4", "0", "0", "0", "0", "0"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]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))

# ----
# number of train data
of_train_data = Slider(10, range=0..1000)

backprop = CrowNetConstructorBackpropagationNetwork(LayerStructure=panel_2, NeuronCount=panel_3, LearningRate=Slider(1, range=0..2))

# ----
# number of data to classify
of_classify_data = Slider(10, range=0..1000)

cull_index = CullIndex(List=flip_matrix, Indices=0, Wrap=True)  # -> simplify(List)
list_item = ListItem(List=flip_matrix, Index=0, Wrap=True)
data = Data(Tree({0;0}: ["pixel0", "pixel1", "pixel2", "pixel3", "pixel4", "pixel5"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], {1;0}: ["0", "0", "0", "0", "0", "0", "0", "0", "0", "0"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], {2;0}: ["0", "0", "0", "0", "0", "0", "0", "0", "0", "0"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], {3;0}: ["0", "0", "0", "0", "0", "0", "0", "0", "0", "0"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], {4;0}: ["0", "0", "0", "0", "0", "0", "0", "0", "0", "0"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], {5;0}: ["0", "0", "0", "0", "0", "0", "0", "0", "0", "0"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]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))
series = Series(Start="1", Step=1, Count=of_train_data)
tree_branch = TreeBranch(Tree=list_item, Path=series, MaintainPaths=True)
tree_branch_2 = TreeBranch(Tree=cull_index, Path=series, MaintainPaths=True)
construct_domain = ConstructDomain(DomainStart=0, DomainEnd=255)
series_2 = Series(Start=of_train_data, Step=1, Count=of_classify_data)
division = Division(A=tree_branch, B=10)
remap_numbers = RemapNumbers(Value=tree_branch_2, Source=construct_domain, Target=Domain(0, 1))  # -> Mapped, Clipped
crow_bp = CrowEngineBackpropagation(Cycles=panel, CrowNetBackpropagation=backprop, TrainingInputVectors=remap_numbers.Mapped, TrainingOutputVectors=division)  # -> MeanSquareError, Network
tree_branch_3 = TreeBranch(Tree=cull_index, Path=series_2, MaintainPaths=True)
tree_branch_4 = TreeBranch(Tree=list_item, Path=series_2, MaintainPaths=True)
remap_numbers_2 = RemapNumbers(Value=tree_branch_3, Source=construct_domain, Target=Domain(0, 1))  # -> Mapped, Clipped
bp_vc = BackpropagationVectorClassifier(CrowNet=crow_bp.Network, InputVector=remap_numbers_2.Mapped)
multiplication = Multiplication(A=bp_vc, B=10)
integer = Integer(multiplication)
panel_4 = Panel(integer)
panel_5 = Panel(tree_branch_4)

equality = Equality(FirstNumber=panel_4, SecondNumber=panel_5)  # -> Equality, Inequality
list_length = ListLength(List=flatten(equality.Equality))
mass_addition = MassAddition(Input=flatten(equality.Equality))  # -> Result, PartialResults
division_2 = Division(A=mass_addition.Result, B=list_length)
panel_6 = Panel("accuracy")
accuracy = Panel(division_2)
