# Grasshopper definition Walker_Gaussian.gh (Grasshopper 0.9.76)
# plug-ins: MeshEdit Components, Python Interpreter, Kangaroo Components, Noise 4D

number_slider = Slider(50, range=0..100)
number_slider_2 = Slider(0.19, range=0..1)
number_slider_3 = Slider(20, range=0..100)
number_slider_4 = Slider(1334, range=0..10000)
number_slider_5 = Slider(0, range=0..100)
number_slider_6 = Slider(76952, range=0..100000)
number_slider_7 = Slider(0.24, range=0..1)
number_slider_8 = Slider(58, range=0..100)

number_slider_9 = Slider(22, range=0..100)
pt = Point(<point referenced from the Rhino model>)
gaussian_ptcloud = PythonScript(
    seed=number_slider_6,
    PointNum=Slider(932, range=0..1000),
    CenterPoint=pt,
    sdX=number_slider_9,
    sdY=number_slider_9,
    sdZ=number_slider_9)  # -> out, a; inputs PointNum: Int32, CenterPoint: Point3d
# ---------- gaussian_ptcloud: Python ----------
import rhinoscriptsyntax as rs
import random as r

r.seed(seed)
if seed == None : seed = 0 
if sdX == None: sdX = 20
if sdY == None: sdY = 20
if sdZ == None: sdZ = 20
if CenterPoint == None : CenterPoint = [0,0,0]
if PointNum == None : PointNum = 50

list = [] 

for c in range(PointNum):
    x = r.gauss(CenterPoint[0],sdX)
    y = r.gauss(CenterPoint[1],sdY)
    z = r.gauss(CenterPoint[2],sdZ)
    
    point = rs.AddPoint(x,y,z)
    
    list.append(point)
    
a = list
# ---------- end gaussian_ptcloud ----------
pt_2 = Point(gaussian_ptcloud.a)

sqgrid = Square(Plane=PlaneXY(0, 0, 0), Size=1, ExtentX=number_slider, ExtentY=number_slider)  # -> Cells, Points
number_slider_10 = Slider(2000, range=0..10000)  # disabled
number_slider_11 = Slider(76952, range=0..100000)  # disabled
python = PythonScript(x=number_slider_8, y=number_slider_8, scaleX=number_slider_7, scaleY=number_slider_7)  # -> out, a; inputs x: Int32, y: Int32
# ---------- python: Python ----------
import rhinoscriptsyntax as rs
import perlin as p

sn = p.SimplexNoise()
pList= []
for i in range(x):
    for j in range(y):
        pVal = sn.noise2(i*scaleX,j*scaleY)
        pt = rs.AddPoint(i,j,pVal)
        pList.append(pt)
        
a = pList
# ---------- end python ----------
python_2 = PythonScript(x=number_slider_3, y=number_slider_3, z=number_slider_3)  # -> out, a; inputs x: Int32, y: Int32, z: Int32
# ---------- python_2: Python ----------
import rhinoscriptsyntax as rs
pList=[]
for i in range(x):
    for j in range(y):
        for k in range(z):
            pList.append(rs.AddPoint(i,j,k))
a = pList
# ---------- end python_2 ----------
perlin = PerlinNoise(Values=sqgrid.Points, Time=0, Scale=number_slider_2)
simplex = SimplexNoise(Values=sqgrid.Points, Time=0, Scale=number_slider_2)
vec = Vector(unitize(Vector(37, 28, 0)))
number_slider_12 = Slider(0.5, range=0..1)
addition = Addition(A=number_slider, B=Slider(1, range=0..1))
python_3 = PythonScript(count=number_slider_4, seed=Slider(58683, range=0..100000), mean=number_slider_5, sd=Slider(25, range=0..100))  # -> out, a; inputs count: Int32
# ---------- python_3: Python ----------
import rhinoscriptsyntax as rs
import random as r

r.seed(seed)

list = [] 

for c in range(count):
    rand = r.gauss(mean,sd)
    list.append(rand)
    
a = list
# ---------- end python_3 ----------
python_4 = PythonScript(count=number_slider_4, seed=Slider(35606, range=0..100000), mean=number_slider_5, sd=Slider(45, range=0..100))  # -> out, a; inputs count: Int32; same code as python_3
python_5 = PythonScript(count=number_slider_4, seed=number_slider_6, mean=number_slider_5, sd=Slider(25, range=0..100))  # -> out, a; inputs count: Int32; same code as python_3
python_6 = PythonScript(time=number_slider_10, seed=number_slider_11)  # -> out, a; inputs time: Int32; disabled
# ---------- python_6: Python ----------
import rhinoscriptsyntax as rs
import random as r

r.seed(seed)

class Walker:
    def __init__(self):
        self.x = 0
        self.y = 0
        self.z = 0
        
    def point(self):
        shape = rs.AddPoint(self.x,self.y,self.z)
        return shape
        
    def step(self):
        
        stepX = r.uniform(-1,1)
        stepY = r.uniform(-1,1)
        stepZ = r.uniform(-1,1)
        
        self.x += stepX
        self.y += stepY
        self.z += stepZ

            
            
w = Walker()

pList = []

for t in range(time):
    w.step()
    pList.append(w.point())

a = pList
print pList
# ---------- end python_6 ----------
pt_3 = Point(python.a)
Z = UnitZ(Factor=perlin)
perlin_2 = PerlinNoise(Values=python_2.a, Time=0, Scale=Slider(0.15, range=0..1))
dom = ConstructDomain(DomainStart=Slider(0.07, range=0..1), DomainEnd=Slider(0.38, range=0..1))
# Computing once. then play
python_7 = PythonScript(time=Slider(3600, range=0..10000), velocity=vec)  # -> out, a; inputs time: Int32
# ---------- python_7: Python ----------
import rhinoscriptsyntax as rs


pos = [50,50,0]

l = []
upperBound = 90
vel = [1,2,0]
for t in range(time):
    
    pos = rs.VectorAdd(pos,vel)
    
    if ((pos[0]<0) or  (pos[0]>upperBound)):
        vel[0] *= -1
    if ((pos[1]<0) or  (pos[1]>upperBound)):
        vel[1] *= -1
        
    #print pos
    sph = rs.AddPoint(pos)
    
    l.append(sph)
    
a = l
# ---------- end python_7 ----------
timer = Timer(TimerInterval=20, Target=counter)
move = Move(Geometry=sqgrid.Points, Motion=Z)  # -> Geometry, Transform
inc = Includes(Value=perlin_2, Domain=dom)  # -> Includes, Deviation
frompoints = MeshFromPoints(Points=pt_3, UDirection=number_slider_8, VDirection=number_slider_8)
pt_4 = ConstructPoint(XCoordinate=python_5.a, YCoordinate=python_4.a, ZCoordinate=python_3.a)
counter = Counter(Reset=Toggle(True))
panel = Panel(python_7.a)
frompoints_2 = MeshFromPoints(Points=flatten(move.Geometry), UDirection=addition, VDirection=addition)
pt_5 = Point(python_7.a)
cull = CullPattern(List=python_2.a, CullPattern=inc.Includes)
medges = MeshEdges(Mesh=frompoints)  # -> NakedEdges, InteriorEdges, NonManifoldEdges
medges_2 = MeshEdges(Mesh=frompoints_2)  # -> NakedEdges, InteriorEdges, NonManifoldEdges
xy = XYPlane(Origin=cull)
panel_2 = Panel(counter)
item = ListItem(List=pt_5, Index=counter, Wrap=True)
box = CenterBox(Base=xy, X=number_slider_12, Y=number_slider_12, Z=number_slider_12)
smesh = SimpleMesh(Brep=box)
